# Grasshopper definition test_revit_create_familyInstance.gh (Grasshopper 1.0.7)
# plug-ins: Bifocals, eleFront

list = ValueList({"Default"}, selected="Default")
gallery = ImageGallery(CycleDelay=30, Randomize=False, UseLocalImages=True, UseRemoteImages=True)
# Write From Library
pt = Point(<point referenced from the Rhino model>)
# Get Symbol
python = GhPythonScript()  # -> out, a
# ---------- python: Python ----------
import clr
clr.AddReference('RevitAPI')

from Autodesk.Revit.DB import BuiltInCategory,FilteredElementCollector,FamilySymbol,BuiltInParameter
from revit.rhinoinside_utils import get_active_doc


def get_built_in_category(category_name):
    try:
        # 文字列からBuiltInCategoryを取得
        category = getattr(BuiltInCategory, category_name)
        return category
    except Exception as e:
        # カテゴリが見つからない場合はNoneを返す
        return None
        
def query_family_type(doc, category, type_name):
    # 指定されたカテゴリとタイプ名に基づいてFamily Typeを取得
    collector = FilteredElementCollector(doc).OfClass(FamilySymbol).OfCategory(category)
    for elem in collector:
        if elem.get_Parameter(BuiltInParameter.ALL_MODEL_TYPE_NAME).AsString() == type_name:
            return elem
    return None
    
# 使用例
category_name = 'OST_Furniture'
category = get_built_in_category(category_name)

doc = get_active_doc()
print(query_family_type(doc,category,'GEL-Chair-一般オフィスチェア'))
# ---------- end python ----------
pt_2 = Point(<point referenced from the Rhino model>)
# Get Symbol Name From CSV
python_2 = GhPythonScript()  # -> out, a
# ---------- python_2: Python ----------
__author__ = "ykish"
__version__ = "2023.11.29"

import rhinoscriptsyntax as rs
from repository.data_processor import find_row_by_name

a = find_row_by_name('Desk','BlockName')
# ---------- end python_2 ----------
reflay = ReferenceByLayer(LayerName=list, lightweight=False)
python_3 = GhPythonScript(point=pt, blockname="Desk")  # -> out, a; inputs point: Point3d
# ---------- python_3: Python ----------
from revit.create_familyInstance import place_family_instance_by_name

familyInstance = place_family_instance_by_name(_blockname, _point)
# ---------- end python_3 ----------
python_4 = GhPythonScript(point=pt_2, blockname="Desk")  # -> out, a; inputs point: Point3d
# ---------- python_4: Python ----------
import clr
clr.AddReference('RevitAPI')
from Autodesk.Revit.DB.Structure import StructuralType
from Autodesk.Revit.DB import BuiltInCategory,FilteredElementCollector,FamilySymbol,BuiltInParameter,XYZ,Transaction
from revit.rhinoinside_utils import get_active_doc
from repository.data_processor import find_row_by_name
from revit.rhinoinside_utils import get_active_doc, convert_rhino_to_revit_geometry

def get_built_in_category(category_name):
    try:
        # 文字列からBuiltInCategoryを取得
        category = getattr(BuiltInCategory, category_name)
        return category
    except Exception as e:
        # カテゴリが見つからない場合はNoneを返す
        return None
        
def query_family_symbol(doc, category, type_name):
    # 指定されたカテゴリとタイプ名に基づいてFamily Typeを取得
    collector = FilteredElementCollector(doc).OfClass(FamilySymbol).OfCategory(category)
    for elem in collector:
        if elem.get_Parameter(BuiltInParameter.ALL_MODEL_TYPE_NAME).AsString() == type_name:
            return elem
    return None
    
def place_family_instance(doc, family_symbol, position):
    # FamilyInstanceを配置するためのトランザクションを開始
    transaction = Transaction(doc, "Place Family Instance")
    transaction.Start()

    try:
        # FamilyInstanceを配置
        instance = doc.Create.NewFamilyInstance(position, family_symbol, StructuralType.NonStructural)
        transaction.Commit()
        return instance
    except Exception as e:
        print(e)
        transaction.RollBack()
        return None
        

famiytypename = find_row_by_name(_blockname,'BlockName')[0]['FamilyType']
category_name = find_row_by_name(_blockname,'BlockName')[0]['BuiltInCategory']
print(famiytypename)
print(category_name)

category = get_built_in_category(category_name)
doc = get_active_doc()

family_symbol = query_family_symbol(doc,category,famiytypename)
print(family_symbol.get_Parameter(BuiltInParameter.ALL_MODEL_TYPE_NAME).AsString())
position = convert_rhino_to_revit_geometry(_point)
desk = place_family_instance(doc, family_symbol, position)

print(desk)
# ---------- end python_4 ----------
panel = Panel(python_2.a)
python_5 = GhPythonScript(dict=python_2.a)  # -> out, a
# ---------- python_5: Python ----------
__author__ = "ykish"
__version__ = "2023.11.29"

import rhinoscriptsyntax as rs

a = dict['FamilyType']
# ---------- end python_5 ----------
panel_2 = Panel(python_5.a)

# ----
# Color Format
# Input
data = Data(1)
# Method
data_2 = Data(1)
# Output
data_3 = Data(1)
# Display
data_4 = Data(1)
# Unuse
data_5 = Data(1)
